# Grasshopper definition kagome.gh (Grasshopper 1.0.7)
# plug-ins: Weaverbird

# compas_kagome
# https://github.com/robin-oval/compas_kagome
# Robin Oval
# rpho2@cam.ac.uk
wbicosahedron = WeaverbirdsMeshMeshIcosahedron(Plane=PlaneXY(0, 0, 0), Radius=5)

thickness = Slider(0.05, range=0..0.1)
width = Slider(0.1, range=0..0.5)

# ----
# INPUT
mesh = Mesh(wbicosahedron)

# ----
# PATTERNING
# Generating a Kagome pattern for
# triaxial weaving from a triangulated mesh
density = Slider(2, range=0..10)
weaving = PythonScript(coarse_tri_mesh=mesh, density=density)  # -> out, pattern
# ---------- weaving: Python ----------
from compas_rhino.geometry import RhinoMesh
from compas.datastructures import Mesh
from compas_kagome.kagome import Kagome

rhino_mesh = RhinoMesh.from_guid(coarse_tri_mesh)
mesh = Mesh.from_vertices_and_faces(rhino_mesh.vertices, rhino_mesh.faces)
pattern = Kagome.from_mesh(mesh, int(density), fixed_boundary=True)
pattern.store_polyedge_data()
# ---------- end weaving ----------

# ----
# Kagome
data = Data(weaving.pattern)

# ----
# Kagome strip boundary
weaving_2 = PythonScript(pattern=data)  # -> out, strip_boundary
# ---------- weaving_2: Python ----------
import rhinoscriptsyntax as rs
from Grasshopper.Kernel.Data import GH_Path
from Grasshopper import DataTree

strip_boundary = DataTree[object]()
for i, polyedge in enumerate(pattern.polyedge_data):
    if pattern.is_edge_on_boundary(*polyedge[:2]):
        is_boundary = True
    else:
        is_boundary = False
    path = GH_Path(i)
    strip_boundary.Add(is_boundary, path)
# ---------- end weaving_2 ----------
# Kagome strip weaving
weaving_3 = PythonScript(pattern=data)  # -> out, strip_directions
# ---------- weaving_3: Python ----------
import rhinoscriptsyntax as rs
from Grasshopper.Kernel.Data import GH_Path
from Grasshopper import DataTree

strip_directions = DataTree[object]()
for i, polyline in enumerate(pattern.polyedge_weaving()):
    for j, direction in enumerate(polyline):
       path = GH_Path(i, j)
       strip_directions.Add(direction, path)
# ---------- end weaving_3 ----------
# Kagome strip frames
weaving_4 = PythonScript(pattern=data)  # -> out, strip_frames
# ---------- weaving_4: Python ----------
import rhinoscriptsyntax as rs
from Grasshopper.Kernel.Data import GH_Path
from Grasshopper import DataTree

strip_frames = DataTree[object]()
for i, polyline in enumerate(pattern.polyline_frames()):
    for j, frame in enumerate(polyline):
       path = GH_Path(i, j)
       strip_frames.AddRange([rs.AddPoint(vector) for vector in frame], path)
# ---------- end weaving_4 ----------
# DATA
# Kagome strip polylines
weaving_5 = PythonScript(pattern=data)  # -> out, strip_polylines
# ---------- weaving_5: Python ----------
import rhinoscriptsyntax as rs
from Grasshopper.Kernel.Data import GH_Path
from Grasshopper import DataTree

strip_polylines = DataTree[object]()
for i, polyline in enumerate(pattern.polylines()):
    for j, point in enumerate(polyline):
        path = GH_Path(i, j)
        strip_polylines.Add(rs.AddPoint(point), path)
# ---------- end weaving_5 ----------
# Kagome strip colours
weaving_6 = PythonScript(pattern=data)  # -> out, strip_colours
# ---------- weaving_6: Python ----------
import rhinoscriptsyntax as rs
from Grasshopper.Kernel.Data import GH_Path
from Grasshopper import DataTree
from compas_kagome.colouring import kagome_polyedge_colouring

polyline_colour = kagome_polyedge_colouring(pattern)

strip_colours = DataTree[object]()
for i, colour in enumerate(polyline_colour):
    strip_colours.Add(colour, GH_Path(i))
# ---------- end weaving_6 ----------
# Kagome singularities
weaving_7 = PythonScript(pattern=data)  # -> out, singular_faces
# ---------- weaving_7: Python ----------
import rhinoscriptsyntax as rs

singular_faces = [rs.AddPolyline([pattern.vertex_coordinates(vkey) for vkey in pattern.face_vertices(fkey) + pattern.face_vertices(fkey)[:1]]) for fkey in pattern.singularities()]
# ---------- end weaving_7 ----------

# ----
# Singularities
swatch = ColourSwatch(SwatchColor=RGB(255, 0, 255))
fpatch = FragmentPatch(Boundary=graft(weaving_7.singular_faces))
preview = CustomPreview(Geometry=fpatch, Shader=swatch)

# ----
# Offset polylines for weaving
item = ListItem(List=weaving_4.strip_frames, Index=0, Wrap=True)
trim = TrimTree(Tree=weaving_5.strip_polylines, Depth=1)
trim_2 = TrimTree(Tree=item, Depth=1)
trim_3 = TrimTree(Tree=weaving_3.strip_directions, Depth=1)
lng = ListLength(List=trim_2)
multiplication = Multiplication(A=trim_3, B=thickness)
repeat = RepeatData(Data=multiplication, Length=lng)
multiplication_2 = Multiplication(A=trim_2, B=repeat)
move = Move(Geometry=trim, Motion=multiplication_2)  # -> simplify(graft(Geometry)), Transform
trim_4 = TrimTree(Tree=move.Geometry, Depth=1)
# PROCESSING
pline = PolyLine(Vertices=trim_4, Closed=False)

# ----
# Polylines
swatch_2 = ColourSwatch(SwatchColor=RGB(0, 0, 0))
pline_2 = PolyLine(Vertices=trim, Closed=False)
preview_2 = CustomPreview(Geometry=pline_2, Shader=swatch_2)

item_2 = ListItem(List=weaving_4.strip_frames, Index=2, Wrap=True)
division = Division(A=width, B=2)
neg = Negative(Value=division)
multiplication_3 = Multiplication(A=item_2, B=[division, neg])
move_2 = Move(Geometry=move.Geometry, Motion=multiplication_3)  # -> Geometry, Transform
item_3 = ListItem(List=move_2.Geometry, Index=0, Wrap=True)  # -> Item, Item1
ln = Line(StartPoint=item_3.Item, EndPoint=item_3.Item1)
trim_5 = TrimTree(Tree=ln, Depth=1)
shift = ShiftList(List=trim_5, Shift=1, Wrap=False)  # -> simplify(List)
split = SplitList(List=reverse(trim_5), Index=1)  # -> ListA, reverse(simplify(ListB))
end = EndPoints(Curve=shift)  # -> graft(Start), graft(End)
end_2 = EndPoints(Curve=split.ListB)  # -> graft(Start), graft(End)
merge = Merge(Data1=end_2.Start, Data2=end_2.End, Data3=end.End, Data4=end.Start)
conmesh = ConstructMesh(Vertices=merge, Faces={A=0, B=1, C=2, D=3})
trim_6 = TrimTree(Tree=conmesh, Depth=1)
wbjoin = WeaverbirdsJoinMeshesAndWeld(Mesh=trim_6, Weld=invert(False))

# ----
# Coloured woven polylines
bnd = Bounds(Numbers=flatten(weaving_6.strip_colours))
dedomain = DeconstructDomain(Domain=bnd)  # -> Start, End
gradient = Gradient(
    LowerLimit=dedomain.Start,
    UpperLimit=dedomain.End,
    Parameter=weaving_6.strip_colours,
    stops=[0: RGB(234, 38, 0), 0.25: RGB(234, 126, 0), 0.5: RGB(254, 244, 84), 0.75: RGB(173, 203, 249), 1: RGB(75, 107, 169)])
preview_3 = CustomPreview(Geometry=pline, Shader=gradient)

# ----
# Coloured woven strips
number_slider = Slider(3, range=0..10)
bnd_2 = Bounds(Numbers=flatten(weaving_6.strip_colours))
toggle = BooleanToggle(True)
dedomain_2 = DeconstructDomain(Domain=bnd_2)  # -> Start, End
wbcatmullclark = WeaverbirdsCatmullClarkSubdivision(MeshCurves=flatten(wbjoin), Level=number_slider, SmoothNakedEdges=1)  # -> flatten(OutputMeshCurves)
division_2 = Division(A=thickness, B=3)
gradient_2 = Gradient(
    LowerLimit=dedomain_2.Start,
    UpperLimit=dedomain_2.End,
    Parameter=weaving_6.strip_colours,
    stops=[0: RGB(234, 38, 0), 0.25: RGB(234, 126, 0), 0.5: RGB(254, 244, 84), 0.75: RGB(173, 203, 249), 1: RGB(75, 107, 169)])
wbthicken = WeaverbirdsMeshThicken(MeshCurves=wbcatmullclark, Distance=division_2, OffsetType=0)  # -> simplify(OutputMeshCurves)
preview_4 = CustomPreview(Geometry=wbthicken, Shader=gradient_2)
