# Grasshopper definition kagome_210409.gh (Grasshopper 1.0.7)
# plug-ins: MeshEdit Components, Weaverbird, Kangaroo2 Components

crv = Curve([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])

# ----
# Starting from a skeleton to clad
crv_2 = Curve([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])
weaving = PythonScript(lines=crv)  # -> out, coarse_trimesh; inputs lines: list
# ---------- weaving: Python ----------
import rhinoscriptsyntax as rs
from statistics import mean
from compas.datastructures import Mesh
from compas_kagome.skeleton import trimesh_skeleton
from compas_rhino.utilities import draw_mesh

size = mean([rs.CurveLength(line) for line in lines]) / 2
lines = [(rs.CurveStartPoint(line), rs.CurveEndPoint(line)) for line in lines]
coarse_trimesh = trimesh_skeleton(Mesh, lines, size)
coarse_trimesh = draw_mesh(*coarse_trimesh.to_vertices_and_faces())
# ---------- end weaving ----------
mesh = Mesh(weaving.coarse_trimesh)

# ----
# Starting with a surface
srf = Surface(<surface referenced from the Rhino model>)
mesh_uv = MeshSurface(Surface=srf, UCount=1, VCount=1, Overhang=True, Equalize=False)
tri = Triangulate(Mesh=mesh_uv)  # -> Mesh, Count
mesh_2 = Mesh(tri.Mesh)

# ----
# Starting with lines for mesh edges
crv_3 = Curve([<curve referenced from the Rhino model> x48])
wbweave = WeaverbirdsMeshFromLinesWeaveBack(Lines=crv_3, MaximumValence=4)
mesh_3 = Mesh(wbweave)

# ----
# Starting with points for Delaunay triangulation
pt = Point([Point(1.476678907, 26.46513558, 0), Point(4.883191147, 27.42976647, 0), Point(6.87886221, 26.49266849, 0), Point(3.813325109, 24.31839287, 0), Point(6.760566701, 23.26280388, 0), Point(1.817610183, 23.18284355, 0), Point(4.141864239, 21.59458429, 0), Point(7.595982356, 21.57847604, 0), Point(8.558504884, 24.41597693, 0)])
del = DelaunayMesh(Points=pt, Plane=PlaneXY(0, 0, 0))
mesh_4 = Mesh(del)

# ----
# INPUT
# Starting with a mesh
mesh_5 = Mesh(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)

# ----
# Starting from a polyhedron
mesh_6 = MeshBrep(Settings={GridMaxCount=0, GridMinCount=16, JaggedSeams=False, MaxEdgeLength=0, MinEdgeLength=0.0001, MinTolerance=0, Refine=True, RefineAngle=0, RelativeTolerance=0.65, SimplePlanes=True, Tolerance=0})
weldvertices = MeshWeldVertices(Mesh=mesh_6, Tolerance=0.01)  # -> RuntimeMessage, Mesh

wbtriangles = WeaverbirdsSplitTrianglesSubdivision(MeshCurves=mesh_3, Level=Slider(3, range=0..10))

# ----
# Generating a Kagome pattern for triaxial weaving from a mesh
density = Slider(2, range=0..10)
# PATTERNING
mesh_7 = Mesh(mesh_3)
weaving_2 = PythonScript(coarse_tri_mesh=mesh_7, density=density)  # -> out, pattern
# ---------- weaving_2: Python ----------
from compas_rhino.geometry import RhinoMesh
from compas.datastructures import Mesh
from compas_kagome.kagome import Kagome

rhino_mesh = RhinoMesh.from_guid(coarse_tri_mesh)
mesh = Mesh.from_vertices_and_faces(rhino_mesh.vertices, rhino_mesh.faces)
pattern = Kagome.from_mesh(mesh, int(density), fixed_boundary=True)
pattern.store_polyedge_data()
# ---------- end weaving_2 ----------

wbloop = WeaverbirdsLoopSubdivision(MeshCurves=mesh, Level=density, SmoothNakedEdges=1)  # disabled
weldvertices_2 = MeshWeldVertices(Mesh=wbtriangles, Tolerance=0.01)  # -> RuntimeMessage, Mesh
weaving_3 = PythonScript(coarse_tri_mesh=weldvertices_2.Mesh, density=density)  # -> out, lines
# ---------- weaving_3: Python ----------
import rhinoscriptsyntax as rs
from compas_rhino.geometry import RhinoMesh
from compas.datastructures import Mesh
from compas_kagome.kagome import Kagome
from compas.datastructures import mesh_conway_ambo

rhino_mesh = RhinoMesh.from_guid(coarse_tri_mesh)
m = Mesh.from_vertices_and_faces(rhino_mesh.vertices, rhino_mesh.faces)
m = mesh_conway_ambo(m)
lines = [rs.AddLine(m.vertex_coordinates(u), m.vertex_coordinates(v)) for u, v in m.edges()]
# ---------- end weaving_3 ----------
rod = Rod(LengthFactor=1, AngleFactor=1, AxialStrength=10, BendStrength=1)
geo = Geometry(weaving_3.lines)
len = Length(Curve=geo)
avr = Average(Input=len)
panel = Panel(weaving_3.out)
length_line = LengthLine(Line=geo, Length=avr, Strength=10)
solver = Solver(GoalObjects=length_line, Reset=False, Threshold=1e-15, Tolerance=0.01, On=True)  # -> I, V, O; disabled

# ----
# UNBUILD AND REBUILD
# FOR FORM FINDING USING LINES
# geometrical
# processing
# of lines
python = PythonScript(pattern=weaving_2.pattern)  # -> out, lines
# ---------- python: Python ----------
import rhinoscriptsyntax as rs

lines = [rs.AddLine(pattern.vertex_coordinates(u), pattern.vertex_coordinates(v)) for u, v in pattern.edges()]
# ---------- end python ----------
crv_4 = Curve(python.lines)
python_2 = PythonScript(lines=crv_4)  # -> out, pattern; inputs lines: list; disabled
# ---------- python_2: Python ----------
import rhinoscriptsyntax as rs
from compas_pattern.datastructures.kagome.kagome import Kagome

lines = [(rs.CurveStartPoint(line), rs.CurveEndPoint(line)) for line in lines]
pattern = Kagome.from_lines(lines, delete_boundary_face=True)
pattern.kagome = pattern.copy()
pattern.store_kagome_polyedge_data()
print pattern.kagome.number_of_edges()
# ---------- end python_2 ----------

geo_2 = Geometry(solver.O)

# ----
# Kagome
data = Data(weaving_2.pattern)

# ----
# Kagome strip boundary
weaving_4 = PythonScript(pattern=data)  # -> out, strip_boundary
# ---------- weaving_4: Python ----------
import rhinoscriptsyntax as rs
from Grasshopper.Kernel.Data import GH_Path
from Grasshopper import DataTree

strip_boundary = DataTree[object]()
for i, polyedge in enumerate(pattern.polyedge_data):
    if pattern.is_edge_on_boundary(*polyedge[:2]):
        is_boundary = True
    else:
        is_boundary = False
    path = GH_Path(i)
    strip_boundary.Add(is_boundary, path)
# ---------- end weaving_4 ----------
# Kagome strip weaving
weaving_5 = PythonScript(pattern=data)  # -> out, strip_directions
# ---------- weaving_5: Python ----------
import rhinoscriptsyntax as rs
from Grasshopper.Kernel.Data import GH_Path
from Grasshopper import DataTree

strip_directions = DataTree[object]()
for i, polyline in enumerate(pattern.polyedge_weaving()):
    for j, direction in enumerate(polyline):
       path = GH_Path(i, j)
       strip_directions.Add(direction, path)
# ---------- end weaving_5 ----------
# Kagome strip frames
weaving_6 = PythonScript(pattern=data)  # -> out, strip_frames
# ---------- weaving_6: Python ----------
import rhinoscriptsyntax as rs
from Grasshopper.Kernel.Data import GH_Path
from Grasshopper import DataTree

strip_frames = DataTree[object]()
for i, polyline in enumerate(pattern.polyline_frames()):
    for j, frame in enumerate(polyline):
       path = GH_Path(i, j)
       strip_frames.AddRange([rs.AddPoint(vector) for vector in frame], path)
# ---------- end weaving_6 ----------
# DATA
# Kagome strip polylines
weaving_7 = PythonScript(pattern=data)  # -> out, strip_polylines
# ---------- weaving_7: Python ----------
import rhinoscriptsyntax as rs
from Grasshopper.Kernel.Data import GH_Path
from Grasshopper import DataTree

strip_polylines = DataTree[object]()
for i, polyline in enumerate(pattern.polylines()):
    for j, point in enumerate(polyline):
        path = GH_Path(i, j)
        strip_polylines.Add(rs.AddPoint(point), path)
# ---------- end weaving_7 ----------
# Kagome strip colours
weaving_8 = PythonScript(pattern=data)  # -> out, strip_colours
# ---------- weaving_8: Python ----------
import rhinoscriptsyntax as rs
from Grasshopper.Kernel.Data import GH_Path
from Grasshopper import DataTree
from compas_kagome.colouring import kagome_polyedge_colouring

polyline_colour = kagome_polyedge_colouring(pattern)

strip_colours = DataTree[object]()
for i, colour in enumerate(polyline_colour):
    strip_colours.Add(colour, GH_Path(i))
# ---------- end weaving_8 ----------
# Kagome singularities
weaving_9 = PythonScript(pattern=data)  # -> out, singular_faces
# ---------- weaving_9: Python ----------
import rhinoscriptsyntax as rs

singular_faces = [rs.AddPolyline([pattern.vertex_coordinates(vkey) for vkey in pattern.face_vertices(fkey) + pattern.face_vertices(fkey)[:1]]) for fkey in pattern.singularities()]
# ---------- end weaving_9 ----------
panel_2 = Panel(weaving_5.out)

# ----
# Offset polylines for weaving
thickness = Slider(0.05, range=0..0.1)
item = ListItem(List=weaving_6.strip_frames, Index=0, Wrap=True)
trim = TrimTree(Tree=weaving_5.strip_directions, Depth=1)
trim_2 = TrimTree(Tree=weaving_7.strip_polylines, Depth=1)
trim_3 = TrimTree(Tree=item, Depth=1)
multiplication = Multiplication(A=trim, B=thickness)
lng = ListLength(List=trim_3)
num = Number(multiplication)
repeat = RepeatData(Data=num, Length=lng)
multiplication_2 = Multiplication(A=trim_3, B=repeat)
move = Move(Geometry=trim_2, Motion=multiplication_2)  # -> simplify(graft(Geometry)), Transform

pline = PolyLine(Vertices=trim_2, Closed=False)
# PROCESSING
preview = CustomPreview(Geometry=pline, Shader=ColourSwatch(SwatchColor=RGB(0, 0, 0)))
data_2 = Data(move.Geometry)

# ----
# Build strips
width = Slider(0.1, range=0..0.5)
item_2 = ListItem(List=weaving_6.strip_frames, Index=2, Wrap=True)
division = Division(A=width, B=2)
multiplication_3 = Multiplication(A=division, B=-1)
multiplication_4 = Multiplication(A=item_2, B=[multiplication_3, division])
move_2 = Move(Geometry=data_2, Motion=multiplication_4)  # -> Geometry, Transform
item_3 = ListItem(List=move_2.Geometry, Index=0, Wrap=True)  # -> Item, Item1
ln = Line(StartPoint=item_3.Item, EndPoint=item_3.Item1)
trim_4 = TrimTree(Tree=ln, Depth=1)
lng_2 = ListLength(List=trim_4)
subtraction = Subtraction(A=lng_2, B=1)
split = SplitList(List=trim_4, Index=subtraction)  # -> simplify(ListA), ListB
shift = ShiftList(List=trim_4, Shift=1, Wrap=False)  # -> simplify(List)
end = EndPoints(Curve=split.ListA)  # -> graft(Start), graft(End)
end_2 = EndPoints(Curve=shift)  # -> graft(Start), graft(End)
merge = Merge(Data1=end.Start, Data2=end.End, Data3=end_2.End, Data4=end_2.Start)
conmesh = ConstructMesh(Vertices=merge, Faces={A=0, B=1, C=2, D=3})
trim_5 = TrimTree(Tree=conmesh, Depth=1)
mjoin = MeshJoin(Meshes=trim_5)
weldvertices_3 = MeshWeldVertices(Mesh=mjoin, Tolerance=0.01)  # -> RuntimeMessage, Mesh
mesh_8 = Mesh(flatten(weldvertices_3.Mesh))

# ----
# Visualise frames
number_slider = Slider(0, range=0..2)
item_4 = ListItem(List=weaving_6.strip_frames, Index=number_slider, Wrap=True)
vdis = VectorDisplay(Anchor=data_2, Vector=item_4)

# ----
# Build polylines
trim_6 = TrimTree(Tree=data_2, Depth=1)
pline_2 = PolyLine(Vertices=trim_6, Closed=False)
crv_5 = Curve(pline_2)

# ----
# Colour strips
bnd = Bounds(Numbers=flatten(weaving_8.strip_colours))
dedomain = DeconstructDomain(Domain=bnd)  # -> Start, End
gradient = Gradient(
    LowerLimit=dedomain.Start,
    UpperLimit=dedomain.End,
    Parameter=weaving_8.strip_colours,
    stops=[0: RGB(234, 38, 0), 0.25: RGB(234, 126, 0), 0.5: RGB(254, 244, 84), 0.75: RGB(173, 203, 249), 1: RGB(75, 107, 169)])
preview_2 = CustomPreview(Geometry=crv_5, Shader=gradient)

panel_3 = Panel("boundary")
panel_4 = Panel("non_boundary")
button = Button()
dispatch = Dispatch(List=flatten(crv_5), DispatchPattern=flatten(weaving_4.strip_boundary))  # -> ListA, ListB

# ----
# Bake strips per group with colour in layers
panel_5 = Panel("")
txt = Text(flatten(weaving_8.strip_colours))
button_2 = Button()
concat = Concatenate(FragmentA=panel_5, FragmentB=txt)

# ----
# Smooth strips
number_slider_2 = Slider(3, range=0..10)
division_2 = Division(A=thickness, B=3)
wbcatmullclark = WeaverbirdsCatmullClarkSubdivision(MeshCurves=mesh_8, Level=number_slider_2, SmoothNakedEdges=1)  # -> flatten(OutputMeshCurves)
toggle = BooleanToggle(True)
m_offset_extrude = MeshOffsetExtrude(M=wbcatmullclark, B=toggle, E=toggle, C0=toggle, C1=toggle, D=division_2)  # -> out, A; inputs M: Mesh, V: list of Vector3d, D: list
# ---------- m_offset_extrude: VB ----------
    Component.Params.Input(0).Name = "Mesh"
    Component.Params.Input(0).Description = "Open or closed mesh"
    Component.Params.Input(1).Name = "Both Sides"
    Component.Params.Input(1).Description = "If true the mesh is offset in both directions along the vertex normals"
    Component.Params.Input(2).Name = "Edges"
    Component.Params.Input(2).Description = "If true the mesh will contain faces on the edges between the two offset mesh faces"
    Component.Params.Input(3).Name = "Closed Bottom"
    Component.Params.Input(3).Description = "If true the mesh will be closed on the origin face"
    Component.Params.Input(4).Name = "Closed Top"
    Component.Params.Input(4).Description = "If true the mesh will be closed on the offset face"
    Component.Params.Input(5).Name = "Vector [Vertex]"
    Component.Params.Input(5).Description = "An optional vector that sets the direction of extrusion, if empty, the new mesh will be offset along the vertex normals"
    Component.Params.Input(6).Name = "Distance [Vertex, Rh Units]"
    Component.Params.Input(6).Description = "A single number or list of numbers corresponding to each vertex of a mesh which sets the Rhino unit based distance that the new geometry is offset from each mesh face"

    Component.Params.Output(1).Name = "Mesh"
    Component.Params.Output(1).Description = "If successful, a valid mesh"

    If m IsNot Nothing Then

      Dim mf As Rhino.Geometry.Collections.MeshFaceList = Nothing
      Dim mv As Rhino.Geometry.Collections.MeshVertexList = Nothing
      Dim mtv As Rhino.Geometry.Collections.MeshTopologyVertexList = Nothing
      Dim mte As Rhino.Geometry.Collections.MeshTopologyEdgeList = Nothing
      Dim mn As Rhino.Geometry.Collections.MeshVertexNormalList = Nothing
      Dim mc As Rhino.Geometry.Collections.MeshVertexColorList = Nothing

      mf = m.Faces
      mv = m.Vertices
      mtv = m.TopologyVertices
      mte = m.TopologyEdges
      mn = m.Normals
      mc = m.VertexColors

      Dim clrB As Boolean = False
      If mc.count() > 0 Then clrB = True

      Dim i,cv,cf,u(1),hd As Integer
      Dim blnV As Boolean
      Dim vec As vector3d
      Dim ova, ovb As New list(Of point3d)
      Dim vf As New list(Of Vector3f)
      Dim ofc As New list(Of MeshFace)
      If b Then hd = 2 Else hd = 1
      
      cv = mv.count()
      cf = mf.count()

      If (D.count() - 1) < cv Then D = matchDbl(D, cv)

      If v.count() > 0 Then
        blnV = True
        If (V.count() - 1) < cv Then V = matchVec(V, cv)
      End If

      'Define Base Vertices
      For i = 0 To cv - 1 Step 1
        If blnV Then vec = V(i) Else vec = mn(i)
        vec.Unitize()
        vec *= (D(i) / hd)

        ovb.add(New point3d(mv(i)) + vec)
        If Not b Then vec *= 0
        vec.Reverse()
        ova.add(New point3d(mv(i)) + vec)
      Next

      If (c0 Or (((Not c0) And (Not e)) And c1)) Then ofc = mf.ToList()

      If ((e or c0) And c1) Then
        For i = 0 To cf - 1 Step 1
          If mf(i).isquad() Then
            ofc.add(New meshface(mf(i).A + cv, mf(i).B + cv, mf(i).C + cv, mf(i).D + cv))
          Else
            ofc.add(New meshface(mf(i).A + cv, mf(i).B + cv, mf(i).C + cv))
          End If
        Next
      End If

      If e Then
        For i = 0 To mte.count() - 1 Step 1

          u(0) = mtv.MeshVertexIndices(mte.GetTopologyVertices(i).I)(0)
          u(1) = mtv.MeshVertexIndices(mte.GetTopologyVertices(i).J)(0)

          If uBound(mte.GetConnectedFaces(i)) < 1 Then
            ofc.add(New meshface(u(0), u(1), u(1) + cv, u(0) + cv))
          End If
        Next
      End If

      Dim mo As New mesh

      If (c0 Or e) Then
        mo.Vertices.AddVertices(ova.toarray())
        If clrB Then mo.VertexColors.AppendColors(mc.ToArray())
      End If
      If (c1 Or e) Then
        mo.Vertices.AddVertices(ovb.toarray())
        If clrB Then mo.VertexColors.AppendColors(mc.ToArray())
      End If

      mo.Faces.AddFaces(ofc)

      A = mo
    End If
# ---------- m_offset_extrude: VB additional code ----------
  Private Function matchDbl(ByVal a As list(Of Double), ByVal t As Integer)
    Dim i,k As Integer
    k = a.count()
    For i = 0 To ((t + 1) - k) - 1 Step 1
      a.add(a.item(k - 1))
    Next
    Return a
  End Function

  Private Function matchVec(ByVal a As list(Of vector3d), ByVal t As Integer)
    Dim i,k As Integer
    k = a.count()
    For i = 0 To ((t + 1) - k) - 1 Step 1
      a.add(a.item(k - 1))
    Next
    Return a
  End Function
# ---------- end m_offset_extrude ----------
unifynormals = MeshUnifyNormals(Mesh=m_offset_extrude.A)

# ----
# Colour strips
bnd_2 = Bounds(Numbers=flatten(weaving_8.strip_colours))
dedomain_2 = DeconstructDomain(Domain=bnd_2)  # -> Start, End
gradient_2 = Gradient(
    LowerLimit=dedomain_2.Start,
    UpperLimit=dedomain_2.End,
    Parameter=weaving_8.strip_colours,
    stops=[0: RGB(234, 38, 0), 0.25: RGB(234, 126, 0), 0.5: RGB(254, 244, 84), 0.75: RGB(173, 203, 249), 1: RGB(75, 107, 169)])
preview_3 = CustomPreview(Geometry=graft(unifynormals), Shader=gradient_2)

# ----
# Bake strips per group with colour in layers
panel_6 = Panel("strip_group_")
txt_2 = Text(flatten(weaving_8.strip_colours))
button_3 = Button()
concat_2 = Concatenate(FragmentA=panel_6, FragmentB=txt_2)

# ----
# Visualise singularities
crv_6 = Curve(graft(weaving_9.singular_faces))
patch = Patch(Curves=crv_6, Spans=20, Flexibility=1, Trim=True)  # disabled

fpatch = FragmentPatch(Boundary=crv_6)

preview_4 = CustomPreview(Geometry=fpatch, Shader=ColourSwatch(SwatchColor=RGB(255, 0, 255)))
