# Grasshopper definition kagome_simplified.gh (Grasshopper 1.0.7)

# compas_kagome
# https://github.com/robin-oval/compas_kagome
# Robin Oval
# rpho2@cam.ac.uk
# INPUT
mesh = Mesh(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)

# ----
# PATTERNING
# Generating a Kagome pattern for
# triaxial weaving from a triangulated mesh
density = Slider(0, range=0..10)
weaving = PythonScript(coarse_tri_mesh=mesh, density=density)  # -> out, pattern
# ---------- weaving: Python ----------
from compas_rhino.geometry import RhinoMesh
from compas.datastructures import Mesh
from compas_kagome.kagome import Kagome

rhino_mesh = RhinoMesh.from_guid(coarse_tri_mesh)
mesh = Mesh.from_vertices_and_faces(rhino_mesh.vertices, rhino_mesh.faces)
pattern = Kagome.from_mesh(mesh, int(density), fixed_boundary=True)
pattern.store_polyedge_data()
# ---------- end weaving ----------

# ----
# Kagome
data = Data(weaving.pattern)

# ----
# DATA
# Kagome strip polylines
weaving_2 = PythonScript(pattern=data)  # -> out, strip_polylines
# ---------- weaving_2: Python ----------
import rhinoscriptsyntax as rs
from Grasshopper.Kernel.Data import GH_Path
from Grasshopper import DataTree

strip_polylines = DataTree[object]()
for i, polyline in enumerate(pattern.polylines()):
    for j, point in enumerate(polyline):
        path = GH_Path(i, j)
        strip_polylines.Add(rs.AddPoint(point), path)
# ---------- end weaving_2 ----------
trim = TrimTree(Tree=weaving_2.strip_polylines, Depth=1)

# ----
# Polylines
swatch = ColourSwatch(SwatchColor=RGB(0, 0, 0))
pline = PolyLine(Vertices=trim, Closed=False)
preview = CustomPreview(Geometry=pline, Shader=swatch)
